# Grasshopper definition test-file.gh (Grasshopper 1.0.7)
# plug-ins: Mallard

list_airtable_records = ListAirtableRecords(
    Refresh=Toggle(False),
    BaseID="app0I4tpf2pXipn6S",
    AppKey="keyjNDU2X6XRFOsxc",
    TableName="Planning-Rooms",
    ViewName="Grid view")  # -> ErrorMessage, OutRecords
